vi "AM.gvi"   [LabVIEW NXG 5.0.0]
panel controls:
  "message_amp": f64 = 1
  "message_freq": f64 = 10
  "message_sample_rate": f64 = 1000
  "message_samples": i32 = 1000
  "carrier_amp": f64 = 1
  "carrier_freq": f64 = 10
  "carrier_sample_rate": f64 = 1000
  "carrier_samples": i32 = 1000
  "carrier_t0": timestamp = 1-01-01T00:00:00Z
  "message_t0": timestamp = 1-01-01T00:00:00Z
panel indicators:
  "message_signal": waveform<f64>
  "carrier_signal": waveform<f64>
  "message_psd": T1
  "am_signal": waveform<f64>
  "am_psd": T1
types:
  T1 = cluster{"f0": f64, "df": f64, "magnitude": f64[]}
uses:
  NI::Analysis::Generation::Sine Waveform.gvi
  NI::Analysis::Measurement::Power Spectral Density for 1 Chan.gvi
diagram:
  call "Sine Waveform.gvi"(sample rate=$message_sample_rate, samples=$message_samples, t0=$message_t0, amplitude=$message_amp, frequency=$message_freq, phase in=90) -> (sine wave=w1)
  $message_signal <- w1
  call "Power Spectral Density for 1 Chan.gvi"(signal=w1) -> (power spectral density=w2)
  $message_psd <- w2
  call "Sine Waveform.gvi"(sample rate=$carrier_sample_rate, samples=$carrier_samples, t0=$carrier_t0, amplitude=$carrier_amp, frequency=$carrier_freq, phase in=90) -> (sine wave=w3)
  $carrier_signal <- w3
  call "Sine Waveform.gvi"(sample rate=$carrier_sample_rate, samples=$carrier_samples, t0=$carrier_t0, amplitude=1, frequency=$carrier_freq, phase in=90) -> (sine wave=w4)
  Waveform Multiply(w1, w4) -> w5
  Waveform Add(w3, w5) -> w6
  $am_signal <- w6
  call "Power Spectral Density for 1 Chan.gvi"(signal=w6) -> (power spectral density=w7)
  $am_psd <- w7
