vi "CLT.gvi"   [LabVIEW NXG 5.0.0]
panel controls:
  "wait_time": u32
  "num_bins": i32 = 10
panel indicators:
  "histogram": T1
types:
  T1 = cluster{"x values": f64[], "histogram h(x)": f64[]}
uses:
  NI::Analysis::Statistics::Statistics (1D DBL).gvi
  NI::Analysis::Statistics::Histogram (single-shot)(DBL Array).gvi
diagram:
  s1 = f64[] []  # shift register
  while (iteration -> i1) {
    Wait(time to wait=$wait_time)
    for (N = 10) {
      for (N = 10) {
        Random Number() -> (number (0 to 1)=w3)
        append w3 to w2
      }
      append w2 to w1
    }
    Add Array Elements(numeric array=w1) -> (sum=w4)
    Divide(x=w4, y=100) -> w5
    Insert Into Array(inArray=s1, index0=i1, new=w5) -> w6
    call "Statistics (1D DBL).gvi"(signal=w6) -> (mean=w7, standard deviation=w8)
    Subtract(x=w6, y=w7) -> w9
    Divide(x=w9, y=w8) -> w10
    call "Histogram (single-shot)(DBL Array).gvi"(signal=w10, number of bins=$num_bins) -> (histogram=w11)
    $histogram <- w11
    Is Greater Or Equal(x=i1, y=1000) -> w12
    next s1 = w6
    stop if w12
  }
