vi "DataTypes.gvi"   [LabVIEW NXG 5.0.0]
panel controls:
  "string": string
panel indicators:
  "is_hot": bool
  "ascii_values": u8[]
diagram:
  String To Byte Array(string=$string) -> (unsigned byte array=w1)
  $ascii_values <- w1
  To Double Precision Float(number=w1) -> w2
  Subtract(x=w2, y=32) -> w3
  Multiply(w3, 0.5555556) -> w4
  Array Size(array=w4) -> (size(s)=w5)
  Add Array Elements(numeric array=w4) -> (sum=w6)
  Divide(x=w6, y=w5) -> w7
  Is Greater Or Equal(x=w7, y=50) -> w8
  $is_hot <- w8
