vi "AMCoherent.gvi"   [LabVIEW NXG 5.0.0]
inputs:
  "am_signal": waveform<f64> = {dt=1, Y=[]}
  "carrier_signal": waveform<f64> = {dt=1, Y=[]}
  "cutoff_freq": f64 = 0.125
  "order": i32 = 2
outputs:
  "am_coherent_demod_signal": waveform<f64>
  "am_coherent_demod_psd": T1
types:
  T1 = cluster{"f0": f64, "df": f64, "magnitude": f64[]}
uses:
  NI::Analysis::Measurement::Peak Amplitude (Wfm).gvi
  NI::Analysis::Filtering::Butterworth Lowpass Filter (Waveform).gvi
  NI::Analysis::Measurement::AC DC and RMS (single-shot)(Wfm).gvi
  NI::Analysis::Measurement::Power Spectral Density for 1 Chan.gvi
diagram:
  call "Peak Amplitude (Wfm).gvi"(signal=$carrier_signal) -> (maximum peak=w1)
  Waveform Divide(x=$carrier_signal, y=w1) -> w2
  Waveform Multiply($am_signal, w2) -> w3
  call "Butterworth Lowpass Filter (Waveform).gvi"(signal=w3, cutoff frequency=$cutoff_freq, order=$order) -> (filtered signal=w4)
  call "AC DC and RMS (single-shot)(Wfm).gvi"(signal=w4) -> (DC value=w5)
  Waveform Subtract(x=w4, y=w5) -> w6
  Waveform Multiply(w6, 2) -> w7
  $am_coherent_demod_signal <- w7
  call "Power Spectral Density for 1 Chan.gvi"(signal=w7) -> (power spectral density=w8)
  $am_coherent_demod_psd <- w8
