vi "AMEnvelopeDetection.gvi"   [LabVIEW NXG 5.0.0]
inputs:
  "am_signal": waveform<f64> = {dt=1, Y=[]}
  "order": i32 = 2
  "low_cutoff_freq": f64 = 0.125
outputs:
  "am_env_det_signal": waveform<f64>
  "am_env_det_psd": T1
types:
  T1 = cluster{"f0": f64, "df": f64, "magnitude": f64[]}
uses:
  NI::Analysis::Filtering::Butterworth Lowpass Filter (Waveform).gvi
  NI::Analysis::Measurement::AC DC and RMS (single-shot)(Wfm).gvi
  NI::Analysis::Measurement::Power Spectral Density for 1 Chan.gvi
diagram:
  Waveform Multiply($am_signal, 3.14159) -> w1
  Property Node(instance in=w1) -> ("Y"=w2, "t0"=w3, "dt"=w4)
  Array Size(array=w2) -> (size(s)=w5)
  s1 = f64[] []  # shift register
  for (N = w5) (iteration -> i1) {
    w6 = each element of w2
    Is Greater Or Equal To 0(x=w6) -> w7
    Select(s=w7, t=w6, f=0) -> w8
    Insert Into Array(inArray=s1, index0=i1, new=w8) -> w9
    next s1 = w9
  }
  Build Waveform Node(Y=s1, dt=w4, t0=w3) -> (output waveform=w10)
  call "Butterworth Lowpass Filter (Waveform).gvi"(signal=w10, cutoff frequency=$low_cutoff_freq, order=$order) -> (filtered signal=w11)
  call "AC DC and RMS (single-shot)(Wfm).gvi"(signal=w11) -> (DC value=w12)
  Waveform Subtract(x=w11, y=w12) -> w13
  call "Power Spectral Density for 1 Chan.gvi"(signal=w13) -> (power spectral density=w14)
  $am_env_det_psd <- w14
  $am_env_det_signal <- w13
