vi "AMTopLevel.gvi"   [LabVIEW NXG 5.0.0]
panel controls:
  "carrier_sample_rate": f64 = 1000
  "carrier_samples": i32 = 1000
  "carrier_t0": timestamp = 1-01-01T00:00:00Z
  "message_freq": f64 = 10
  "message_amp": f64 = 1
  "carrier_freq": f64 = 10
  "carrier_amp": f64 = 1
  "message_sample_rate": f64 = 1000
  "message_samples": i32 = 1000
  "message_t0": timestamp = 1-01-01T00:00:00Z
  "coherent_cutoff_freq": f64 = 0.125
  "coherent_order": i32 = 2
  "env_det_order": i32 = 2
  "env_det_cutoff_freq": f64 = 0.125
  "stop": bool
panel indicators:
  "am_coherent_demodulated": waveform<f64>
  "am_coherent_demodulated_psd": T1
  "am_env_det_signal": waveform<f64>
  "am_env_det_psd": T1
  "message_signal": waveform<f64>
  "message_psd": T1
types:
  T1 = cluster{"f0": f64, "df": f64, "magnitude": f64[]}
diagram:
  while {
    call "AM.gvi"(message_sample_rate=$message_sample_rate, message_samples=$message_samples, message_t0=$message_t0, message_freq=$message_freq, message_amp=$message_amp, carrier_freq=$carrier_freq, carrier_amp=$carrier_amp, carrier_sample_rate=$carrier_sample_rate, carrier_samples=$carrier_samples, carrier_t0=$carrier_t0) -> (message_signal=w1, carrier_signal=w2, am_signal=w3, message_psd=w4)
    $message_signal <- w1
    $message_psd <- w4
    call "AMCoherent.gvi"(am_signal=w3, carrier_signal=w2, cutoff_freq=$coherent_cutoff_freq, order=$coherent_order) -> (am_coherent_demodulated=w5, am_coherent_demoulated_psd=w6)
    $am_coherent_demodulated <- w5
    $am_coherent_demodulated_psd <- w6
    call "AMEnvelopeDetection.gvi"(am_signal=w3, order=$env_det_order, low_cutoff_freq=$env_det_cutoff_freq) -> (am_env_det_signal=w7, am_env_det_psd=w8)
    $am_env_det_signal <- w7
    $am_env_det_psd <- w8
    stop if $stop
  }
