vi "USRP_AM_Rx_Music.gvi"   [LabVIEW NXG 3.1.0]
panel controls:
  "number of samples": i64 = 200000
  "IQ rate": f64 = 100000
  "carrier frequency": f64 = 400000000
  "gain": f64
  "active antenna": string = "RX2"
  "Stop": bool
  "device names": "USRP niUSRPClass"
  "low cutoff frequency": f64 = 5000
  "Digital signal gain": f64 = 3
panel indicators:
  "coerced IQ rate": f64
  "coerced carrier frequency": f64
  "coerced gain": f64
  "Error Out": error
  "Demodulated signal": waveform<f64>
  "Demodulated PSD": T1
  "size(s)": i32
types:
  T1 = cluster{"f0": f64, "df": f64, "magnitude": f64[]}
  "Sound Data Format.gtype" = cluster{"sample rate (S/s)": f64, "number of channels": i32, "bits per sample": i32}
uses:
  NI::USRP::niUSRP Open Rx Session.gvi
  NI::USRP::niUSRP Configure Signal.gvi
  NI::G Core::Sound::Output::Sound Output Configure.gvi
  NI::USRP::niUSRP Initiate.gvi
  NI::USRP::niUSRP Fetch Rx Data (CDB WDT).gvi
  NI::USRP::niUSRP Abort.gvi
  NI::Analysis::Measurement::AC DC and RMS (single-shot)(1D DBL).gvi
  NI::Analysis::Filtering::Butterworth Lowpass Filter (DBL).gvi
  NI::G Core::Sound::Output::Sound Output Write::Sound Output Write (DBL Single).gvi
  NI::Analysis::Measurement::Power Spectrum for 1 Chan.gvi
  NI::USRP::niUSRP Close Session.gvi
diagram:
  call "niUSRP Open Rx Session.gvi"(device names=$"device names") -> (session handle out=w1, error out=w2)
  call "niUSRP Configure Signal.gvi"(active antenna=$"active antenna", session handle=w1, error in=w2, IQ rate=$"IQ rate", carrier frequency=$"carrier frequency", gain=$gain) -> (session handle out=w3, error out=w4, coerced IQ rate=w5, coerced carrier frequency=w6, coerced gain=w7)
  $"coerced IQ rate" <- w5
  $"coerced carrier frequency" <- w6
  w8 = $"number of samples"
  w9 = "Sound Data Format.gtype" {"sample rate (S/s)"=44100, "number of channels"=1, "bits per sample"=32}
  call "Sound Output Configure.gvi"(device ID=0, sound format=w9) -> (task ID=w10)
  s1 = w4  # shift register
  while {
    call "niUSRP Initiate.gvi"(session handle=w3, error in=s1) -> (session handle out=w11, error out=w12)
    call "niUSRP Fetch Rx Data (CDB WDT).gvi"(session handle=w11, error in=w12, number of samples=w8) -> (session handle out=w13, error out=w14, data=w15)
    call "niUSRP Abort.gvi"(session handle=w13, error in=w14) -> (session handle out=w16, error out=w17)
    Property Node(instance in=w15) -> ("Y"=w18, "t0"=w19, "dt"=w20)
    Reciprocal(x=w20) -> w21
    Complex To Real Imaginary(x + iy=w18) -> (x=w22)
    call "AC DC and RMS (single-shot)(1D DBL).gvi"(signal=w22) -> (DC value=w23)
    Subtract(x=w22, y=w23) -> w24
    call "Butterworth Lowpass Filter (DBL).gvi"(signal=w24, sampling frequency=w21, cutoff frequency=$"low cutoff frequency", order=5) -> (filtered signal=w25)
    Multiply(w25, $"Digital signal gain") -> w26
    Build Waveform Node(Y=w26, dt=w20, t0=w19) -> (output waveform=w27)
    call "Sound Output Write (DBL Single).gvi"(task ID in=w10, data=w27)
    $"Demodulated signal" <- w27
    call "Power Spectrum for 1 Chan.gvi"(signal=w27) -> (power spectrum=w28)
    $"Demodulated PSD" <- w28
    Array Size(array=w22) -> (size(s)=w29)
    $"size(s)" <- w29
    Property Node(instance in=w14) -> ("status"=w30)
    Logical Or(w30, $Stop) -> w31
    next s1 = w17
    stop if w31
  }
  call "niUSRP Close Session.gvi"(session handle=w16, error in=s1) -> (error out=w32)
  $"Error Out" <- w32
  $"coerced gain" <- w7
