vi "FM Music.gvi"   [LabVIEW NXG 5.0.0]
panel controls:
  "Stop": bool
  "active antenna": string = "RX1"
  "IQ rate": f64 = 200000
  "carrier frequency": f64 = 95700000
  "gain": f64
  "number of samples": i64 = 10000
  "Low cutoff freq": f64 = 10000
  "delta f_demod": f64 = 500
  "device names": "USRP niUSRPClass"
  "sound format": "sound format.gtype" = {"sample rate (S/s)"=44100, "number of channels"=1, "bits per sample"=16}
panel indicators:
  "coerced gain": f64
  "coerced frequency": f64
  "coerced IQ rate": f64
  "Error Out": error
  "Demod. Msg (Time domain)": waveform<f64>
  "Demod. Msg (Freq domain)": T1
types:
  T1 = cluster{"f0": f64, "df": f64, "magnitude": f64[]}
  "sound format.gtype" = cluster{"sample rate (S/s)": f64, "number of channels": i32, "bits per sample": i32}
uses:
  NI::USRP::niUSRP Open Rx Session.gvi
  NI::USRP::niUSRP Configure Signal.gvi
  NI::USRP::niUSRP Initiate.gvi
  NI::USRP::niUSRP Fetch Rx Data (CDB Cluster).gvi
  NI::Analysis::IntegralDifferentiation::Derivative x(t).gvi
  NI::Analysis::Filtering::Butterworth Lowpass Filter (DBL).gvi
  NI::Analysis::Measurement::AC DC and RMS (single-shot)(1D DBL).gvi
  NI::Analysis::Measurement::Power Spectrum for 1 Chan.gvi
  NI::USRP::niUSRP Abort.gvi
  NI::USRP::niUSRP Close Session.gvi
diagram:
  call "niUSRP Open Rx Session.gvi"(device names=$"device names") -> (session handle out=w1, error out=w2)
  call "niUSRP Configure Signal.gvi"(active antenna=$"active antenna", session handle=w1, error in=w2, IQ rate=$"IQ rate", carrier frequency=$"carrier frequency", gain=$gain) -> (session handle out=w3, error out=w4, coerced IQ rate=w5, coerced carrier frequency=w6, coerced gain=w7)
  call "niUSRP Initiate.gvi"(session handle=w3, error in=w4) -> (session handle out=w8, error out=w9)
  call "Simple Sound.gvi"(Action="Open", sound format=$"sound format") -> (sample rate (S/s)=w10, task ID out=w11, Error=w12)
  Reciprocal(x=w5) -> w13
  while {
    call "niUSRP Fetch Rx Data (CDB Cluster).gvi"(session handle=w8, error in=w9, number of samples=$"number of samples") -> (session handle out=w14, error out=w15, data=w16)
    Property Node(instance in=w16) -> ("Y"=w17, "dt"=w18)
    Complex To Real And Imaginary(x + iy=w17) -> (x=w19, y=w20)
    call "Derivative x(t).gvi"(dt=w18, x(t)=w19) -> (dx(t)/dt=w21)
    Multiply(w21, w20) -> w22
    Reciprocal(x=w18) -> w23
    call "Butterworth Lowpass Filter (DBL).gvi"(signal=w22, sampling frequency=w23, cutoff frequency=$"Low cutoff freq", order=5) -> (filtered signal=w24)
    call "AC DC and RMS (single-shot)(1D DBL).gvi"(signal=w24) -> (DC value=w25)
    Subtract(x=w24, y=w25) -> w26
    Multiply(6.28318530718, $"delta f_demod") -> w27
    Divide(x=w26, y=w27) -> w28
    Build Waveform Node(Y=w28, dt=w18) -> (output waveform=w29)
    $"Demod. Msg (Time domain)" <- w29
    call "Power Spectrum for 1 Chan.gvi"(signal=w29) -> (power spectrum=w30)
    $"Demod. Msg (Freq domain)" <- w30
    Property Node(instance in=w15) -> ("status"=w31)
    call "Simple Resample.gvi"(input=w28, coerced IQ rate=w5, sample rate (S/s)=w10) -> (output=w32)
    Build Waveform Node(Y=w32, dt=w13) -> (output waveform=w33)
    call "Simple Sound.gvi"(Action="Write", data=w33, task ID in=w11, error in (no error)=w12) -> (task ID out=w34, Error=w35)
    Property Node(instance in=w35) -> ("status"=w36)
    Logical Or(w36, w31, $Stop) -> w37
    stop if w37
  }
  call "Simple Sound.gvi"(Action="Close", task ID in=w34, error in (no error)=w35) -> (Error=w38)
  Merge Errors(w15, w38) -> (error out=w39)
  call "niUSRP Abort.gvi"(session handle=w14, error in=w39) -> (session handle out=w40, error out=w41)
  call "niUSRP Close Session.gvi"(session handle=w40, error in=w41) -> (error out=w42)
  $"Error Out" <- w42
  $"coerced IQ rate" <- w5
  $"coerced frequency" <- w6
  $"coerced gain" <- w7
