vi "FMDemodulator.gvi"   [LabVIEW NXG 5.0.0]
inputs:
  "fm_signal": waveform<f64> = {dt=1, Y=[]}
  "low_cutoff_freq": f64 = 0.125
  "order": i32 = 2
  "kf": f64
  "Ac": f64
outputs:
  "demod_signal": waveform<f64>
  "demod_psd": T1
  "filtered_signal": waveform<f64>
  "test": waveform<f64>
types:
  T1 = cluster{"f0": f64, "df": f64, "magnitude": f64[]}
uses:
  NI::Analysis::IntegralDifferentiation::Derivative x(t).gvi
  NI::Analysis::Filtering::Butterworth Lowpass Filter (Waveform).gvi
  NI::Analysis::Measurement::AC DC and RMS (single-shot)(Wfm).gvi
  NI::Analysis::Measurement::Power Spectral Density for 1 Chan.gvi
diagram:
  Property Node(instance in=$fm_signal) -> ("Y"=w1, "t0"=w2, "dt"=w3)
  call "Derivative x(t).gvi"(dt=w3, x(t)=w1) -> (dx(t)/dt=w4)
  Array Size(array=w4) -> (size(s)=w5)
  s1 = uninitialised  # shift register
  for (N = w5) (iteration -> i1) {
    w6 = each element of w4
    Is Greater Or Equal To 0(x=w6) -> w7
    Select(s=w7, t=w6, f=0) -> w8
    Insert Into Array(inArray=s1, index0=i1, new=w8) -> w9
    next s1 = w9
  }
  Build Waveform Node(Y=s1, dt=w3, t0=w2) -> (output waveform=w10)
  $test <- w10
  call "Butterworth Lowpass Filter (Waveform).gvi"(signal=w10, cutoff frequency=$low_cutoff_freq, order=$order) -> (filtered signal=w11)
  call "AC DC and RMS (single-shot)(Wfm).gvi"(signal=w11) -> (DC value=w12)
  Waveform Subtract(x=w11, y=w12) -> w13
  Multiply($kf, $Ac) -> w14
  Multiply(w14, 2) -> w15
  Waveform Divide(x=w13, y=w15) -> w16
  call "Power Spectral Density for 1 Chan.gvi"(signal=w16) -> (power spectral density=w17)
  $demod_psd <- w17
  $filtered_signal <- w11
  $demod_signal <- w16
