vi "FMDemodulator_2.gvi"   [LabVIEW NXG 5.0.0]
inputs:
  "fm_signal": waveform<f64> = {dt=1, Y=[]}
  "low_cutoff_freq": f64 = 0.125
  "order": i32 = 2
  "kf": f64
  "Ac": f64
outputs:
  "demod_signal": waveform<f64>
  "demod_psd": T1
  "filtered_signal": waveform<f64>
  "test": waveform<f64>
types:
  T1 = cluster{"f0": f64, "df": f64, "magnitude": f64[]}
uses:
  NI::Analysis::IntegralDifferentiation::Derivative x(t).gvi
  NI::Analysis::Filtering::Butterworth Lowpass Filter (Waveform).gvi
  NI::Analysis::Measurement::AC DC and RMS (single-shot)(Wfm).gvi
  NI::Analysis::Measurement::Power Spectral Density for 1 Chan.gvi
diagram:
  Property Node(instance in=$fm_signal) -> ("Y"=w1, "t0"=w2, "dt"=w3)
  call "Derivative x(t).gvi"(dt=w3, x(t)=w1) -> (dx(t)/dt=w4)
  Array Size(array=w4) -> (size(s)=w5)
  s1 = uninitialised  # shift register
  for (N = w5) (iteration -> i1) {
    w6 = each element of w4
    Is Greater Or Equal To 0(x=w6) -> w7
    Select(s=w7, t=1, f=0) -> w8
    Insert Into Array(inArray=s1, index0=i1, new=w8) -> w9
    next s1 = w9
  }
  Is Greater Or Equal To 0(x=w4) -> w10
  Boolean To 0 Or 1(Boolean=w10) -> (0, 1=w11)
  Multiply(w11, w4) -> w12
  Multiply(w4, w12) -> w13
  Build Waveform Node(Y=w13, dt=w3, t0=w2) -> (output waveform=w14)
  $test <- w14
  call "Butterworth Lowpass Filter (Waveform).gvi"(signal=w14, cutoff frequency=$low_cutoff_freq, order=$order) -> (filtered signal=w15)
  call "AC DC and RMS (single-shot)(Wfm).gvi"(signal=w15) -> (DC value=w16)
  Waveform Subtract(x=w15, y=w16) -> w17
  Multiply($kf, $Ac) -> w18
  Multiply(w18, 2) -> w19
  Waveform Divide(x=w17, y=w19) -> w20
  call "Power Spectral Density for 1 Chan.gvi"(signal=w20) -> (power spectral density=w21)
  $demod_psd <- w21
  $filtered_signal <- w15
  $demod_signal <- w20
