vi "FMTopLevel2.gvi"   [LabVIEW NXG 5.0.0]
panel controls:
  "stop": bool
  "message_amp": f64 = 1
  "message_freq": f64 = 10
  "message_sample_rate": f64 = 1000
  "message_samples": i32 = 1000
  "kf": f64
  "message_t0": timestamp = 1-01-01T00:00:00Z
  "carrier_amp": f64 = 1
  "carrier_freq": f64 = 10
  "carrier_sample_rate": f64 = 1000
  "carrier_samples": i32 = 1000
  "carrier_t0": timestamp = 1-01-01T00:00:00Z
  "low_cutoff_freq": f64 = 0.125
  "order": i32 = 2
panel indicators:
  "message_psd": T1
  "message_signal": waveform<f64>
  "fm_signal": waveform<f64>
  "fm_psd": T1
  "demod_signal": waveform<f64>
  "demod_psd": T1
  "filtered_signal": waveform<f64>
  "test": waveform<f64>
types:
  T1 = cluster{"f0": f64, "df": f64, "magnitude": f64[]}
diagram:
  while {
    call "FM_Modulator.gvi"(carrier_amp=$carrier_amp, carrier_freq=$carrier_freq, carrier_sample_rate=$carrier_sample_rate, carrier_samples=$carrier_samples, carrier_t0=$carrier_t0, message_amp=$message_amp, message_freq=$message_freq, message_sample_rate=$message_sample_rate, message_samples=$message_samples, kf=$kf, message_t0=$message_t0) -> (fm_signal=w1, fm_spectrum=w2, message_signal=w3, message_spectrum=w4)
    $fm_signal <- w1
    call "FMDemodulator_2.gvi"(kf=$kf, Ac=$carrier_amp, fm_signal=w1, low_cutoff_freq=$low_cutoff_freq, order=$order) -> (demod_signal=w5, demod_psd=w6, filtered_signal=w7, test=w8)
    $demod_signal <- w5
    $demod_psd <- w6
    $fm_psd <- w2
    $filtered_signal <- w7
    $message_signal <- w3
    $test <- w8
    $message_psd <- w4
    stop if $stop
  }
