vi "FM_Modulator.gvi"   [LabVIEW NXG 5.0.0]
inputs:
  "message_amp": f64 = 1
  "message_freq": f64 = 10
  "message_sample_rate": f64 = 1000
  "message_samples": i32 = 1000
  "kf": f64
  "message_t0": timestamp = 1-01-01T00:00:00Z
  "carrier_amp": f64 = 1
  "carrier_freq": f64 = 10
  "carrier_sample_rate": f64 = 1000
  "carrier_samples": i32 = 1000
  "carrier_t0": timestamp = 1-01-01T00:00:00Z
outputs:
  "fm_signal": waveform<f64>
  "fm_spectrum": T1
  "message_signal": waveform<f64>
  "message_spectrum": T1
types:
  T1 = cluster{"f0": f64, "df": f64, "magnitude": f64[]}
uses:
  NI::Analysis::Generation::Sine Waveform.gvi
  NI::Analysis::IntegralDifferentiation::Integral x(t).gvi
  NI::Analysis::Measurement::Power Spectral Density for 1 Chan.gvi
diagram:
  call "Sine Waveform.gvi"(sample rate=$carrier_sample_rate, samples=$carrier_samples, t0=$carrier_t0, amplitude=$carrier_amp, frequency=$carrier_freq, phase in=0) -> (sine wave=w1)
  call "Sine Waveform.gvi"(sample rate=$message_sample_rate, samples=$message_samples, t0=$message_t0, amplitude=$message_amp, frequency=$message_freq, phase in=90) -> (sine wave=w2)
  Property Node(instance in=w2) -> ("Y"=w3, "t0"=w4, "dt"=w5)
  call "Integral x(t).gvi"(dt=w5, x(t)=w3) -> (integral x(t)=w6)
  Multiply(w6, 6.28319) -> w7
  Multiply(w7, $kf) -> w8
  Sine And Cosine(x=w8) -> (cos(x)=w9, sin(x)=w10)
  Build Waveform Node(Y=w10, dt=w5, t0=w4) -> (output waveform=w11)
  Waveform Multiply(w1, w11) -> w12
  call "Sine Waveform.gvi"(sample rate=$carrier_sample_rate, samples=$carrier_samples, t0=$carrier_t0, amplitude=$carrier_amp, frequency=$carrier_freq, phase in=90) -> (sine wave=w13)
  Build Waveform Node(Y=w9, dt=w5, t0=w4) -> (output waveform=w14)
  Waveform Multiply(w13, w14) -> w15
  Waveform Subtract(x=w15, y=w12) -> w16
  call "Power Spectral Density for 1 Chan.gvi"(signal=w16) -> (power spectral density=w17)
  $fm_spectrum <- w17
  $message_signal <- w2
  $fm_signal <- w16
  call "Power Spectral Density for 1 Chan.gvi"(signal=w2) -> (power spectral density=w18)
  $message_spectrum <- w18
