vi "FM_USRP_Tx-Rx.gvi"   [LabVIEW NXG 5.0.0]
panel controls:
  "IQ rate Tx": f64 = 500000
  "carrier frequency Tx": f64 = 400000000
  "gain Tx": f64
  "active antenna Tx": string = "TX1"
  "IQ rate Rx": f64 = 500000
  "carrier frequency Rx": f64 = 400000000
  "gain Rx": f64
  "active antenna Rx": string = "RX2"
  "Stop Tx": bool
  "Stop Rx": bool
  "msg. freq.": f64 = 1000
  "msg. amplitude": f64 = 1
  "delta f": f64 = 30000
  "Low cutoff freq": f64 = 10000
  "delta f_demod": f64 = 500
  "number of samples": f64 = 200000
  "device names": "USRP niUSRPClass"
panel indicators:
  "coerced IQ rate Rx": f64
  "coerced carrier frequency Rx": f64
  "coerced gain 2": f64
  "error out": error
  "Demod. Msg (Time domain)": waveform<f64>
  "Demod. Msg (Freq domain)": T1
  "Error Out_2": error
  "FM spectrum": T1
types:
  T1 = cluster{"f0": f64, "df": f64, "magnitude": f64[]}
uses:
  NI::USRP::niUSRP Open Tx Session.gvi
  NI::USRP::niUSRP Configure Signal.gvi
  NI::Analysis::Generation::Sine Waveform.gvi
  NI::Analysis::IntegralDifferentiation::Integral x(t) Compatibility.gvi
  NI::USRP::niUSRP Write Tx Data (CDB).gvi
  NI::USRP::niUSRP Close Session.gvi
  NI::USRP::niUSRP Open Rx Session.gvi
  NI::USRP::niUSRP Initiate.gvi
  NI::USRP::niUSRP Fetch Rx Data (CDB WDT).gvi
  NI::Analysis::IntegralDifferentiation::Derivative x(t).gvi
  NI::Analysis::Filtering::Butterworth Lowpass Filter (DBL).gvi
  NI::Analysis::Measurement::AC DC and RMS (single-shot)(1D DBL).gvi
  NI::Analysis::Measurement::Power Spectrum for 1 Chan.gvi
  NI::USRP::niUSRP Abort.gvi
diagram:
  w1 = $"number of samples"
  w2 = $"IQ rate Tx"
  call "niUSRP Open Tx Session.gvi"(device names=$"device names") -> (session handle out=w3, error out=w4)
  call "niUSRP Configure Signal.gvi"(active antenna=$"active antenna Tx", session handle=w3, error in=w4, IQ rate=w2, carrier frequency=$"carrier frequency Tx", gain=$"gain Tx") -> (session handle out=w5, error out=w6)
  while {
    call "Sine Waveform.gvi"(sample rate=w2, samples=w1, amplitude=$"msg. amplitude", frequency=$"msg. freq.", phase in=0) -> (sine wave=w7)
    Property Node(instance in=w7) -> ("Y"=w8, "dt"=w9, "t0"=w10)
    call "Integral x(t) Compatibility.gvi"(x(t)=w8, dt=w9) -> (integral x(t)=w11)
    Multiply(6.28318530718, $"delta f") -> w12
    Multiply(w11, w12) -> w13
    Sine And Cosine(x=w13) -> (cos(x)=w14, sin(x)=w15)
    Real And Imaginary To Complex(x=w14, y=w15) -> w16
    call "niUSRP Write Tx Data (CDB).gvi"(session handle=w5, error in=w6, data=w16, end of data?=$"Stop Tx") -> (session handle out=w17, error out=w18)
    Property Node(instance in=w18) -> ("status"=w19)
    Logical Or(w19, $"Stop Tx") -> w20
    Build Cluster(w16, w9, w10) -> w21
    call "FFT Power Spectrum for 1 Chan (CDB)3.gvi"(time signal=w21) -> (power spectrum=w22)
    $"FM spectrum" <- w22
    stop if w20
  }
  call "niUSRP Close Session.gvi"(session handle=w17, error in=w18) -> (error out=w23)
  $"error out" <- w23
  call "niUSRP Open Rx Session.gvi"(device names=$"device names") -> (session handle out=w24)
  call "niUSRP Configure Signal.gvi"(active antenna=$"active antenna Rx", session handle=w24, IQ rate=$"IQ rate Rx", carrier frequency=$"carrier frequency Rx", gain=$"gain Rx") -> (session handle out=w25, error out=w26, coerced IQ rate=w27, coerced carrier frequency=w28, coerced gain=w29)
  $"coerced IQ rate Rx" <- w27
  $"coerced carrier frequency Rx" <- w28
  call "niUSRP Initiate.gvi"(session handle=w25, error in=w26) -> (session handle out=w30, error out=w31)
  while {
    To Signed 64 Bit Integer(number=w1) -> w32
    call "niUSRP Fetch Rx Data (CDB WDT).gvi"(session handle=w30, error in=w31, number of samples=w32) -> (session handle out=w33, error out=w34, data=w35)
    Property Node(instance in=w35) -> ("Y"=w36, "dt"=w37)
    Complex To Real And Imaginary(x + iy=w36) -> (x=w38, y=w39)
    call "Derivative x(t).gvi"(dt=w37, x(t)=w38) -> (dx(t)/dt=w40)
    Multiply(w40, w39) -> w41
    Reciprocal(x=w37) -> w42
    call "Butterworth Lowpass Filter (DBL).gvi"(signal=w41, sampling frequency=w42, cutoff frequency=$"Low cutoff freq", order=5) -> (filtered signal=w43)
    call "AC DC and RMS (single-shot)(1D DBL).gvi"(signal=w43) -> (DC value=w44)
    Subtract(x=w43, y=w44) -> w45
    Multiply(6.28318530718, $"delta f_demod") -> w46
    Divide(x=w45, y=w46) -> w47
    Build Waveform Node(Y=w47, dt=w37) -> (output waveform=w48)
    $"Demod. Msg (Time domain)" <- w48
    call "Power Spectrum for 1 Chan.gvi"(signal=w48) -> (power spectrum=w49)
    $"Demod. Msg (Freq domain)" <- w49
    Property Node(instance in=w34) -> ("status"=w50)
    Logical Or(w50, $"Stop Rx") -> w51
    stop if w51
  }
  call "niUSRP Abort.gvi"(session handle=w33, error in=w34) -> (session handle out=w52, error out=w53)
  call "niUSRP Close Session.gvi"(session handle=w52, error in=w53) -> (error out=w54)
  $"Error Out_2" <- w54
  $"coerced gain 2" <- w29
