vi "Find Radio Station.gvi"   [LabVIEW NXG 5.0.0]
panel controls:
  "IQ rate": f64 = 20000000
  "carrier frequency": f64 = 90000000
  "gain (dB)": f64
  "active antenna": string = "RX1"
  "timeout": f64 = 10
  "number of samples": i64 = 200000
  "device names": "USRP niUSRPClass"
panel indicators:
  "coerced gain": f64
  "coerced frequency": f64
  "coerced IQ rate": f64
  "Frequency Plot": T1
  "Error Out": error
types:
  T1 = cluster{"f0": f64, "df": f64, "magnitude": f64[]}
uses:
  NI::USRP::niUSRP Open Rx Session.gvi
  NI::USRP::niUSRP Configure Signal.gvi
  NI::USRP::niUSRP Initiate.gvi
  NI::USRP::niUSRP Fetch Rx Data (CDB).gvi
  NI::USRP::niUSRP Abort.gvi
  NI::USRP::niUSRP Close Session.gvi
  NI::Analysis::Measurement::FFT Power Spectrum for 1 Chan Compatibility (CDB).gvi
diagram:
  call "niUSRP Open Rx Session.gvi"(device names=$"device names") -> (session handle out=w1, error out=w2)
  call "niUSRP Configure Signal.gvi"(active antenna=$"active antenna", session handle=w1, error in=w2, IQ rate=$"IQ rate", carrier frequency=$"carrier frequency", gain=$"gain (dB)") -> (session handle out=w3, error out=w4, coerced IQ rate=w5, coerced carrier frequency=w6, coerced gain=w7)
  call "niUSRP Initiate.gvi"(session handle=w3, error in=w4) -> (session handle out=w8, error out=w9)
  call "niUSRP Fetch Rx Data (CDB).gvi"(session handle=w8, error in=w9, number of samples=$"number of samples", timeout=$timeout) -> (session handle out=w10, error out=w11, data=w12)
  call "niUSRP Abort.gvi"(session handle=w10, error in=w11) -> (session handle out=w13, error out=w14)
  call "niUSRP Close Session.gvi"(session handle=w13, error in=w14) -> (error out=w15)
  $"Error Out" <- w15
  Reciprocal(x=w5) -> w16
  w17 = cluster{"t0": timestamp, "dt": f64, "Y": c128[]} {all zero or empty}
  Property Node(instance in=w17, "Y"=w12, "dt"=w16) -> (instance out=w18)
  call "FFT Power Spectrum for 1 Chan Compatibility (CDB).gvi"(signal=w18, dB on=TRUE) -> (power spectrum=w19)
  $"Frequency Plot" <- w19
  $"coerced IQ rate" <- w5
  $"coerced frequency" <- w6
  $"coerced gain" <- w7
