vi "BPSK_FEC_Decoder.gvi"   [LabVIEW NXG 5.0.0]
inputs:
  "in_arr": f64[]
outputs:
  "out_arr": i32[]
panel controls:
  "stop": bool
panel indicators:
  "size(s)": i32
diagram:
  Array Size(array=$in_arr) -> (size(s)=w1)
  Divide(x=w1, y=3) -> w2
  s1 = i32[] []  # shift register
  for (N = w2) (iteration -> i1) {
    Multiply(3, i1) -> w3
    Array Index(array=$in_arr) -> (out0[w3]=w4)
    Is Greater Than 0(x=w4) -> w5
    Increment(x=w3) -> w6
    Array Index(array=$in_arr) -> (out0[w6]=w7)
    Is Greater Than 0(x=w7) -> w8
    Increment(x=w6) -> w9
    Array Index(array=$in_arr) -> (out0[w9]=w10)
    Is Greater Than 0(x=w10) -> w11
    Build Array(w5, w8, w11) -> w12
    Boolean Array To Number(Boolean array=w12) -> (number=w13)
    Array Index(array=[0, 0, 0, 1, 0, 1, 1, 1]) -> (out0[w13]=w14)
    Insert Into Array(inArray=s1, index0=i1, new=w14) -> w15
    next s1 = w15
    stop if $stop
  }
  Array Size(array=s1) -> (size(s)=w16)
  $"size(s)" <- w16
  $out_arr <- s1
