vi "BPSK_FEC_Tx_Rx_Template_2.gvi"   [LabVIEW NXG 5.0.0]
panel controls:
  "IQ rate": f64 = 200000
  "device names": "USRP niUSRPClass"
  "carrier frequency": f64 = 400000000
  "gain Tx": f64
  "active antenna Tx": string = "TX1"
  "stop Tx": bool
  "gain Rx": f64
  "active antenna Rx": string = "RX2"
  "total bits": i32 = 128
panel indicators:
  "Baseband Waveform": waveform<c128>
  "Baseband Power Spectrum_Tx": T1
  "Baseband Power Spectrum_Rx": T1
  "output_bits": i32[]
  "BER": f64
  "trigger found?": bool
  "out_size": i32
types:
  T1 = cluster{"f0": f64, "df": f64, "magnitude": f64[]}
uses:
  NI::USRP::niUSRP Open Rx Session.gvi
  NI::USRP::niUSRP Configure Signal.gvi
  NI::USRP::niUSRP Initiate.gvi
  NI::USRP::niUSRP Fetch Rx Data (CDB).gvi
  NI::USRP::niUSRP Close Session.gvi
  NI::Modulation::MT Generate Bits (Galois, PN Order).gvi
  NI::Modulation::MT Generate Filter Coefficients.gvi
  NI::Analysis::Operations::1D Convolution (DBL).gvi
  NI::Analysis::Resampling::Decimate (single shot, DBL).gvi
  NI::Modulation::MT Calculate BER After Trigger (PN Sequence).gvi
  NI::USRP::niUSRP Open Tx Session.gvi
  NI::Analysis::Resampling::Upsample (DBL).gvi
  NI::USRP::niUSRP Write Tx Data (CDB).gvi
diagram:
  # Transmitter
  # Receiver
  call "niUSRP Open Rx Session.gvi"(device names=$"device names") -> (session handle out=w1, error out=w2)
  call "niUSRP Configure Signal.gvi"(active antenna=$"active antenna Rx", session handle=w1, error in=w2, IQ rate=$"IQ rate", carrier frequency=$"carrier frequency", gain=$"gain Rx") -> (session handle out=w3, error out=w4, coerced carrier frequency=w5)
  Subtract(x=w5, y=20000) -> w6
  Property Node(instance in=w3, "niUSRP"=w6) -> (instance out=w7)
  call "niUSRP Initiate.gvi"(session handle=w7, error in=w4) -> (session handle out=w8, error out=w9)
  call "niUSRP Fetch Rx Data (CDB).gvi"(session handle=w8, error in=w9, number of samples=1000000) -> (session handle out=w10, error out=w11, data=w12)
  call "niUSRP Close Session.gvi"(session handle=w10, error in=w11)
  call "MT Generate Bits (Galois, PN Order).gvi"(total bits=$"total bits") -> (output bit stream=w13)
  call "DuplicateBits3.gvi"(input=w13) -> (output=w14)
  Array Size(array=w14) -> (size(s)=w15)
  call "MT Generate Filter Coefficients.gvi"(pulse shaping filter="Root Raised Cos", matched samples per symbol=20, modulation type="PSK") -> (matched filter coefficients=w16)
  call "FrameSync (Complex).gvi"(Sampled Input=w12) -> (Aligned Samples=w17)
  call "Channel Estimator.gvi"(input signal=w17) -> (signal out=w18)
  Complex To Real And Imaginary(x + iy=w18) -> w19
  call "1D Convolution (DBL).gvi"(x=w19, y=w16) -> (x * y=w20)
  call "PulseAlign (Real).gvi"(Input signal=w20, Receiver Sampling Factor=20) -> (aligned output=w21)
  call "Decimate (single shot, DBL).gvi"(signal=w21, decimating factor=20) -> (decimated signal=w22)
  call "FrameSync (Real).gvi"(Sampled Input=w22) -> (Aligned Samples=w23)
  Array Size(array=w23) -> (size(s)=w24)
  s1 = bool[] []  # shift register
  for (N = w24) (iteration -> i1) {
    w25 = each element of w23
    Is Greater Than 0(x=w25) -> w26
    Insert Into Array(inArray=s1, index0=i1, new=w26) -> w27
    next s1 = w27
  }
  Boolean To 0 Or 1(Boolean=s1) -> (0, 1=w28)
  Array Subset(array=w28, index0=0, length0=w15) -> w29
  call "BPSK_FEC_Decoder.gvi"(in_arr=w29) -> (out_arr=w30)
  Array Size(array=w30) -> (size(s)=w31)
  $out_size <- w31
  $output_bits <- w30
  call "MT Calculate BER After Trigger (PN Sequence).gvi"(input bit stream=w30, BER trigger threshold=0.4) -> (BER=w32, trigger found?=w33)
  $BER <- w32
  call "niUSRP Open Tx Session.gvi"(device names=$"device names") -> (session handle out=w34, error out=w35)
  call "niUSRP Configure Signal.gvi"(active antenna=$"active antenna Tx", session handle=w34, error in=w35, IQ rate=$"IQ rate", carrier frequency=$"carrier frequency", gain=$"gain Tx") -> (session handle out=w36, error out=w37)
  s2 = f64[] []  # shift register
  for (N = w15) (iteration -> i2) {
    w38 = each element of w14
    Is Equal(x=w38, y=1) -> w39
    Select(s=w39, t=w38, f=-1) -> w40
    Insert Into Array(inArray=s2, index0=i2, new=w40) -> w41
    next s2 = w41
  }
  To Double Precision Float(number=s2) -> w42
  call "AddFrameHeader.gvi"(array=w42) -> (output array=w43)
  call "Upsample (DBL).gvi"(signal=w43, upsampling factor=20) -> (upsampled signal=w44)
  call "MT Generate Filter Coefficients.gvi"(pulse shaping filter="Root Raised Cos", pulse shaping samples per symbol=20, modulation type="PSK") -> (pulse shaping filter coefficients=w45)
  call "1D Convolution (DBL).gvi"(x=w44, y=w45) -> (x * y=w46)
  call "Quick Scale 1D.gvi"(X=w46) -> (Y[i]=X[i]/Max|X|=w47)
  Real And Imaginary To Complex(x=w47, y=0) -> w48
  Build Waveform Node(Y=w48, dt=5e-06) -> (output waveform=w49)
  call "Insert Pilots.gvi"(signal input=w49) -> (output signal=w50)
  call "AddFrameHeader (complex).gvi"(array=w50) -> (output array=w51)
  while {
    call "niUSRP Write Tx Data (CDB).gvi"(session handle=w36, error in=w37, data=w51) -> (session handle out=w52, error out=w53)
    stop if $"stop Tx"
  }
  call "niUSRP Close Session.gvi"(session handle=w52, error in=w53)
  $"trigger found?" <- w33
  w54 = cluster{"t0": timestamp, "dt": f64, "Y": c128[]} {all zero or empty}
  Property Node(instance in=w54, "dt"=5e-06, "Y"=w20) -> (instance out=w55)
  call "FFT Power Spectrum for 1 Chan (CDB)2.gvi"(time signal=w55, dB On (F)=TRUE) -> (power spectrum=w56)
  $"Baseband Power Spectrum_Rx" <- w56
  $"Baseband Waveform" <- w49
  w57 = cluster{"t0": timestamp, "dt": f64, "Y": c128[]} {all zero or empty}
  Property Node(instance in=w57, "dt"=5e-06, "Y"=w48) -> (instance out=w58)
  call "FFT Power Spectrum for 1 Chan (CDB)2.gvi"(time signal=w58, dB On (F)=TRUE) -> (power spectrum=w59)
  $"Baseband Power Spectrum_Tx" <- w59
