vi "BPSK_Tx_Rx_Template.gvi"   [LabVIEW NXG 5.0.0]
panel controls:
  "IQ rate": f64 = 200000
  "device names": "USRP niUSRPClass"
  "carrier frequency": f64 = 400000000
  "gain Tx": f64
  "active antenna Tx": string = "TX1"
  "stop Tx": bool
  "gain Rx": f64
  "active antenna Rx": string = "RX2"
  "total bits": i32 = 128
panel indicators:
  "Baseband Waveform": waveform<c128>
  "Baseband Power Spectrum_Tx": T1
  "Baseband Power Spectrum_Rx": T1
  "output_bits": i16[]
  "BER": f64
  "trigger found?": bool
  "message_size": i32
  "demod_size": i32
types:
  T1 = cluster{"f0": f64, "df": f64, "magnitude": f64[]}
uses:
  NI::USRP::niUSRP Open Rx Session.gvi
  NI::USRP::niUSRP Configure Signal.gvi
  NI::USRP::niUSRP Initiate.gvi
  NI::USRP::niUSRP Fetch Rx Data (CDB).gvi
  NI::USRP::niUSRP Close Session.gvi
  NI::Modulation::MT Generate Filter Coefficients.gvi
  NI::Analysis::Operations::1D Convolution (DBL).gvi
  NI::Analysis::Resampling::Decimate (single shot, DBL).gvi
  NI::Modulation::MT Calculate BER After Trigger (PN Sequence).gvi
  NI::USRP::niUSRP Open Tx Session.gvi
  NI::Modulation::MT Generate Bits (Galois, PN Order).gvi
  NI::Analysis::Resampling::Upsample (DBL).gvi
  NI::USRP::niUSRP Write Tx Data (CDB).gvi
diagram:
  # Transmitter
  # Receiver
  call "niUSRP Open Rx Session.gvi"(device names=$"device names") -> (session handle out=w1, error out=w2)
  call "niUSRP Configure Signal.gvi"(active antenna=$"active antenna Rx", session handle=w1, error in=w2, IQ rate=$"IQ rate", carrier frequency=$"carrier frequency", gain=$"gain Rx") -> (session handle out=w3, error out=w4, coerced carrier frequency=w5)
  Subtract(x=w5, y=20000) -> w6
  Property Node(instance in=w3, "niUSRP"=w6) -> (instance out=w7)
  call "niUSRP Initiate.gvi"(session handle=w7, error in=w4) -> (session handle out=w8, error out=w9)
  call "niUSRP Fetch Rx Data (CDB).gvi"(session handle=w8, error in=w9, number of samples=1000000) -> (session handle out=w10, error out=w11, data=w12)
  call "niUSRP Close Session.gvi"(session handle=w10, error in=w11)
  call "MT Generate Filter Coefficients.gvi"(pulse shaping filter="Root Raised Cos", matched samples per symbol=20, modulation type="PSK") -> (matched filter coefficients=w13)
  call "FrameSync (Complex).gvi"(Sampled Input=w12) -> (Aligned Samples=w14)
  call "Channel Estimator.gvi"(input signal=w14) -> (signal out=w15)
  Complex To Real And Imaginary(x + iy=w15) -> w16
  call "1D Convolution (DBL).gvi"(x=w16, y=w13) -> (x * y=w17)
  call "PulseAlign (Real).gvi"(Input signal=w17, Receiver Sampling Factor=20) -> (aligned output=w18)
  call "Decimate (single shot, DBL).gvi"(signal=w18, decimating factor=20) -> (decimated signal=w19)
  call "FrameSync (Real).gvi"(Sampled Input=w19) -> (Aligned Samples=w20)
  Array Size(array=w20) -> (size(s)=w21)
  s1 = bool[] []  # shift register
  for (N = w21) (iteration -> i1) {
    w22 = each element of w20
    Is Greater Than 0(x=w22) -> w23
    Insert Into Array(inArray=s1, index0=i1, new=w23) -> w24
    next s1 = w24
  }
  Boolean To 0 Or 1(Boolean=s1) -> (0, 1=w25)
  Array Subset(array=w25, index0=0, length0=$"total bits") -> w26
  Array Size(array=w26) -> (size(s)=w27)
  $demod_size <- w27
  $output_bits <- w26
  call "MT Calculate BER After Trigger (PN Sequence).gvi"(input bit stream=w26, BER trigger threshold=0.4) -> (BER=w28, trigger found?=w29)
  $BER <- w28
  call "niUSRP Open Tx Session.gvi"(device names=$"device names") -> (session handle out=w30, error out=w31)
  call "niUSRP Configure Signal.gvi"(active antenna=$"active antenna Tx", session handle=w30, error in=w31, IQ rate=$"IQ rate", carrier frequency=$"carrier frequency", gain=$"gain Tx") -> (session handle out=w32, error out=w33)
  call "MT Generate Bits (Galois, PN Order).gvi"(total bits=$"total bits") -> (output bit stream=w34)
  Array Size(array=w34) -> (size(s)=w35)
  s2 = i8[] []  # shift register
  for (N = w35) (iteration -> i2) {
    w36 = each element of w34
    Is Equal(x=w36, y=1) -> w37
    Select(s=w37, t=w36, f=-1) -> w38
    Insert Into Array(inArray=s2, index0=i2, new=w38) -> w39
    next s2 = w39
  }
  To Double Precision Float(number=s2) -> w40
  call "AddFrameHeader.gvi"(array=w40) -> (output array=w41)
  call "Upsample (DBL).gvi"(signal=w41, upsampling factor=20) -> (upsampled signal=w42)
  call "MT Generate Filter Coefficients.gvi"(pulse shaping filter="Root Raised Cos", pulse shaping samples per symbol=20, modulation type="PSK") -> (pulse shaping filter coefficients=w43)
  call "1D Convolution (DBL).gvi"(x=w42, y=w43) -> (x * y=w44)
  call "Quick Scale 1D.gvi"(X=w44) -> (Y[i]=X[i]/Max|X|=w45)
  Real And Imaginary To Complex(x=w45, y=0) -> w46
  Build Waveform Node(Y=w46, dt=5e-06) -> (output waveform=w47)
  call "Insert Pilots.gvi"(signal input=w47) -> (output signal=w48)
  call "AddFrameHeader (complex).gvi"(array=w48) -> (output array=w49)
  while {
    call "niUSRP Write Tx Data (CDB).gvi"(session handle=w32, error in=w33, data=w49) -> (session handle out=w50, error out=w51)
    stop if $"stop Tx"
  }
  call "niUSRP Close Session.gvi"(session handle=w50, error in=w51)
  $"trigger found?" <- w29
  w52 = cluster{"t0": timestamp, "dt": f64, "Y": c128[]} {all zero or empty}
  Property Node(instance in=w52, "dt"=5e-06, "Y"=w17) -> (instance out=w53)
  call "FFT Power Spectrum for 1 Chan (CDB)2.gvi"(time signal=w53, dB On (F)=TRUE) -> (power spectrum=w54)
  $"Baseband Power Spectrum_Rx" <- w54
  Array Size(array=s2) -> (size(s)=w55)
  $message_size <- w55
  $"Baseband Waveform" <- w47
  w56 = cluster{"t0": timestamp, "dt": f64, "Y": c128[]} {all zero or empty}
  Property Node(instance in=w56, "dt"=5e-06, "Y"=w46) -> (instance out=w57)
  call "FFT Power Spectrum for 1 Chan (CDB)2.gvi"(time signal=w57, dB On (F)=TRUE) -> (power spectrum=w58)
  $"Baseband Power Spectrum_Tx" <- w58
