vi "CalculateBER.gvi"   [LabVIEW NXG 5.0.0]
panel controls:
  "in_arr": i32[]
  "ref_arr": i32[]
  "trigger": f64
panel indicators:
  "BER": f64
  "is_triggered": bool
diagram:
  Array Size(array=$in_arr) -> (size(s)=w1)
  s1 = 0  # shift register
  for (N = w1) {
    w2 = each element of $in_arr
    w3 = each element of $ref_arr
    Is Equal(x=w2, y=w3) -> w4
    Boolean To 0 Or 1(Boolean=w4) -> (0, 1=w5)
    Add(w5, s1) -> w6
    next s1 = w6
  }
  Divide(x=s1, y=w1) -> w7
  $BER <- w7
  Is Greater Or Equal(x=w7, y=$trigger) -> w8
  $is_triggered <- w8
