vi "DPSK_Tx_Rx_Template.gvi"   [LabVIEW NXG 5.0.0]
panel controls:
  "IQ rate": f64 = 200000
  "device names": "USRP niUSRPClass"
  "carrier frequency": f64 = 400000000
  "gain Tx": f64
  "active antenna Tx": string = "TX1"
  "stop Tx": bool
  "gain Rx": f64
  "active antenna Rx": string = "RX2"
  "total bits": i32 = 128
panel indicators:
  "Baseband Waveform": waveform<c128>
  "Baseband Power Spectrum_Tx": T1
  "Baseband Power Spectrum_Rx": T1
  "output_bits": i16[]
  "BER": f64
  "trigger found?": bool
types:
  T1 = cluster{"f0": f64, "df": f64, "magnitude": f64[]}
uses:
  NI::USRP::niUSRP Open Rx Session.gvi
  NI::USRP::niUSRP Configure Signal.gvi
  NI::USRP::niUSRP Initiate.gvi
  NI::USRP::niUSRP Fetch Rx Data (CDB).gvi
  NI::USRP::niUSRP Close Session.gvi
  NI::Modulation::MT Generate Filter Coefficients.gvi
  NI::Analysis::Operations::1D Convolution (CDB).gvi
  NI::Analysis::Resampling::Decimate (single shot, CDB).gvi
  NI::Modulation::MT Calculate BER After Trigger (PN Sequence).gvi
  NI::USRP::niUSRP Open Tx Session.gvi
  NI::Modulation::MT Generate Bits (Galois, PN Order).gvi
  NI::Analysis::Resampling::Upsample (DBL).gvi
  NI::Analysis::Operations::1D Convolution (DBL).gvi
  NI::USRP::niUSRP Write Tx Data (CDB).gvi
diagram:
  # Transmitter
  # Receiver
  call "niUSRP Open Rx Session.gvi"(device names=$"device names") -> (session handle out=w1, error out=w2)
  call "niUSRP Configure Signal.gvi"(active antenna=$"active antenna Rx", session handle=w1, error in=w2, IQ rate=$"IQ rate", carrier frequency=$"carrier frequency", gain=$"gain Rx") -> (session handle out=w3, error out=w4, coerced carrier frequency=w5)
  Subtract(x=w5, y=20000) -> w6
  Property Node(instance in=w3, "niUSRP"=w6) -> (instance out=w7)
  call "niUSRP Initiate.gvi"(session handle=w7, error in=w4) -> (session handle out=w8, error out=w9)
  call "niUSRP Fetch Rx Data (CDB).gvi"(session handle=w8, error in=w9, number of samples=1000000) -> (session handle out=w10, error out=w11, data=w12)
  call "niUSRP Close Session.gvi"(session handle=w10, error in=w11)
  call "MT Generate Filter Coefficients.gvi"(pulse shaping filter="Root Raised Cos", matched samples per symbol=20, modulation type="PSK") -> (matched filter coefficients=w13)
  call "1D Convolution (CDB).gvi"(x=w12, y=w13) -> (x * y=w14)
  call "PulseAlign (Complex).gvi"(Input signal=w14, Receiver Sampling Factor=20) -> (aligned output=w15)
  call "Decimate (single shot, CDB).gvi"(signal=w15, decimating factor=20) -> (decimated signal=w16)
  Array Size(array=w16) -> (size(s)=w17)
  Decrement(x=w17) -> w18
  s1 = uninitialised  # shift register
  for (N = w18) (iteration -> i1) {
    Increment(x=i1) -> w19
    Array Index(array=w16) -> (out0[w19]=w20)
    Array Index(array=w16) -> (out0[i1]=w21)
    Complex Conjugate(x + iy=w21) -> w22
    Multiply(w20, w22) -> w23
    Insert Into Array(inArray=s1, index0=i1, new=w23) -> w24
    next s1 = w24
  }
  Complex To Real And Imaginary(x + iy=s1) -> w25
  call "FrameSync (Real).gvi"(Sampled Input=w25) -> (Aligned Samples=w26)
  Array Size(array=w26) -> (size(s)=w27)
  s2 = uninitialised  # shift register
  for (N = w27) (iteration -> i2) {
    w28 = each element of w26
    Is Greater Than 0(x=w28) -> w29
    Insert Into Array(inArray=s2, index0=i2, new=w29) -> w30
    next s2 = w30
  }
  Boolean To 0 Or 1(Boolean=s2) -> (0, 1=w31)
  Array Subset(array=w31, index0=0, length0=$"total bits") -> w32
  $output_bits <- w32
  call "MT Calculate BER After Trigger (PN Sequence).gvi"(input bit stream=w32, BER trigger threshold=0.4) -> (BER=w33, trigger found?=w34)
  $BER <- w33
  call "niUSRP Open Tx Session.gvi"(device names=$"device names") -> (session handle out=w35, error out=w36)
  call "niUSRP Configure Signal.gvi"(active antenna=$"active antenna Tx", session handle=w35, error in=w36, IQ rate=$"IQ rate", carrier frequency=$"carrier frequency", gain=$"gain Tx") -> (session handle out=w37, error out=w38)
  call "MT Generate Bits (Galois, PN Order).gvi"(total bits=$"total bits") -> (output bit stream=w39)
  Array Size(array=w39) -> (size(s)=w40)
  s3 = uninitialised  # shift register
  for (N = w40) (iteration -> i3) {
    w41 = each element of w39
    Is Equal(x=w41, y=1) -> w42
    Select(s=w42, t=w41, f=-1) -> w43
    Insert Into Array(inArray=s3, index0=i3, new=w43) -> w44
    next s3 = w44
  }
  To Double Precision Float(number=s3) -> w45
  call "AddFrameHeader.gvi"(array=w45) -> (output array=w46)
  Array Size(array=w46) -> (size(s)=w47)
  s4 = uninitialised  # shift register
  for (N = w47) (iteration -> i4) {
    w48 = each element of w46
    Is Equal To 0(x=i4) -> w49
    Decrement(x=i4) -> w50
    Array Index(array=s4) -> (out0[w50]=w51)
    Select(s=w49, t=1, f=w51) -> w52
    Multiply(w48, w52) -> w53
    Insert Into Array(inArray=s4, index0=i4, new=w53) -> w54
    next s4 = w54
  }
  Insert Into Array(inArray=s4, index0=0, new=1) -> w55
  call "Upsample (DBL).gvi"(signal=w55, upsampling factor=20) -> (upsampled signal=w56)
  call "MT Generate Filter Coefficients.gvi"(pulse shaping filter="Root Raised Cos", pulse shaping samples per symbol=20, modulation type="PSK") -> (pulse shaping filter coefficients=w57)
  call "1D Convolution (DBL).gvi"(x=w56, y=w57) -> (x * y=w58)
  call "Quick Scale 1D.gvi"(X=w58) -> (Y[i]=X[i]/Max|X|=w59)
  Real And Imaginary To Complex(x=w59, y=0) -> w60
  Build Waveform Node(Y=w60, dt=5e-06) -> (output waveform=w61)
  while {
    call "niUSRP Write Tx Data (CDB).gvi"(session handle=w37, error in=w38, data=w61) -> (session handle out=w62, error out=w63)
    stop if $"stop Tx"
  }
  call "niUSRP Close Session.gvi"(session handle=w62, error in=w63)
  $"trigger found?" <- w34
  w64 = cluster{"t0": timestamp, "dt": f64, "Y": c128[]} {all zero or empty}
  Property Node(instance in=w64, "dt"=5e-06, "Y"=w14) -> (instance out=w65)
  call "FFT Power Spectrum for 1 Chan (CDB)2.gvi"(time signal=w65, dB On (F)=TRUE) -> (power spectrum=w66)
  $"Baseband Power Spectrum_Rx" <- w66
  $"Baseband Waveform" <- w61
  w67 = cluster{"t0": timestamp, "dt": f64, "Y": c128[]} {all zero or empty}
  Property Node(instance in=w67, "dt"=5e-06, "Y"=w60) -> (instance out=w68)
  call "FFT Power Spectrum for 1 Chan (CDB)2.gvi"(time signal=w68, dB On (F)=TRUE) -> (power spectrum=w69)
  $"Baseband Power Spectrum_Tx" <- w69
