vi "DuplicateBits3.gvi"   [LabVIEW NXG 5.0.0]
inputs:
  "input": f64[]
outputs:
  "output": f64[]
diagram:
  Array Size(array=$input) -> (size(s)=w1)
  for (N = w1) {
    w2 = each element of $input
    Build Array(w2, w2, w2) -> w4
    concatenate w4 onto w3
  }
  $output <- w3
