vi "PulseAlign (Real).gvi"   [LabVIEW Communications System Design Suite 2.0.1]
inputs:
  "Input signal": f64[]
  "Receiver Sampling Factor": i32 = 100
  "error in (no error)": error
outputs:
  "aligned output": f64[]
  "alignment offset (samples)": i32
  "error out": error
panel indicators:
  "Objective Function": f64[]
uses:
  NI::Analysis::Resampling::Decimate (single shot, DBL).gvi
diagram:
  for (N = $"Receiver Sampling Factor") (iteration -> i1) {
    Array Subset(array=$"Input signal", index0=i1) -> w2
    call "Decimate (single shot, DBL).gvi"(input array=w2, decimating factor=$"Receiver Sampling Factor") -> (decimated array=w3, error out=w4)
    Square(x=w3) -> w5
    Add Array Elements(numeric array=w5) -> (sum=w6)
    Property Node(instance in=w4)
    append w6 to w1
  }
  $"Objective Function" <- w1
  Array Max And Min(array=w1) -> (max index(es)=w7)
  $"alignment offset (samples)" <- w7
  $"error out" <- $"error in (no error)"
  Array Subset(array=$"Input signal", index0=w7) -> w8
  $"aligned output" <- w8
