vi "temp-test-2.gvi"   [LabVIEW NXG 5.0.0]
panel controls:
  "in_arr": f64[]
panel indicators:
  "out_arr": f64[]
diagram:
  Array Size(array=$in_arr) -> (size(s)=w1)
  s1 = uninitialised  # shift register
  for (N = w1) (iteration -> i1) {
    w2 = each element of $in_arr
    Is Equal To 0(x=i1) -> w3
    Decrement(x=i1) -> w4
    Array Index(array=s1) -> (out0[w4]=w5)
    Select(s=w3, t=1, f=w5) -> w6
    Multiply(w2, w6) -> w7
    Insert Into Array(inArray=s1, index0=i1, new=w7) -> w8
    next s1 = w8
  }
  Insert Into Array(inArray=s1, index0=0, new=1) -> w9
  $out_arr <- w9
