vi "temp-test.gvi"   [LabVIEW NXG 5.0.0]
panel controls:
  "total bits": i32 = 128
panel indicators:
  "Mapped symbols": i8[]
  "output bit stream": i8[]
uses:
  NI::Modulation::MT Generate Bits (Galois, PN Order).gvi
diagram:
  call "MT Generate Bits (Galois, PN Order).gvi"(total bits=$"total bits") -> (output bit stream=w1)
  $"output bit stream" <- w1
  Array Size(array=w1) -> (size(s)=w2)
  s1 = uninitialised  # shift register
  for (N = w2) (iteration -> i1) {
    w3 = each element of w1
    Is Equal(x=w3, y=1) -> w4
    Select(s=w4, t=w3, f=-1) -> w5
    Insert Into Array(inArray=s1, index0=i1, new=w5) -> w6
    next s1 = w6
  }
  $"Mapped symbols" <- s1
